# Grasshopper definition RhinoInside.gh (Grasshopper 1.0.8)
# plug-ins: AutoCad

txt = LayerName("M$_Текст_h2_5")

# ----
# Линейный размер с поворотом
button = Button()
pt = Point(simplify(graft(Point(3907.567079, 783.4042817, 0))))
pt_2 = Point(simplify(graft(Point(5547.212058, 1634.460536, 0))))
txt_2 = LayerName("M$_Тонкая")
line = Line(Line((3685.267976, 1479.857644, 0), (5421.604911, 2020.20899, 0)))
линейный_размер_повернут_v_2 = CSharpScript(dimensionLine=line, dimensionStart=pt, dimensionEnd=pt_2, layerName=txt_2, bake=button, dimensionStyleName="М1_50")  # -> out, A; inputs dimensionLine: Line, dimensionStart: Point3d, dimensionEnd: Point3d, layerName: String, bake: Boolean, dimensionStyleName: String, userOverrideText: String
# ---------- линейный_размер_повернут_v_2: C# ----------
// Grasshopper Script Instance
#region Usings
using System;
using System.Collections.Generic;

#r "C:\\Program Files\\Autodesk\\AutoCAD 2020\\accoremgd.dll"   // это ключевой для Document, Application и DocumentLock
#r "C:\\Program Files\\Autodesk\\AutoCAD 2020\\acmgd.dll"
#r "C:\\Program Files\\Autodesk\\AutoCAD 2020\\acdbmgd.dll"
#r "C:\Program Files\Autodesk\AutoCAD 2020\accoremgd.dll"
#r "C:\\Program Files\\Autodesk\\AutoCAD 2020\\acdbmgdbrep.dll"

using Rhino;
using Rhino.Geometry;

using Grasshopper;
using Grasshopper.Kernel;
using Grasshopper.Kernel.Data;
using Grasshopper.Kernel.Types;

// ----- AutoCAD -----
using Autodesk.AutoCAD.ApplicationServices;
using Autodesk.AutoCAD.EditorInput;
using AGeom = Autodesk.AutoCAD.Geometry;
using AcadDb = Autodesk.AutoCAD.DatabaseServices;
using SysEx = System.Exception;
using AcadEx = Autodesk.AutoCAD.Runtime.Exception;
#endregion

public class Script_Instance : GH_ScriptInstance
{
    #region Notes
    /* 
      Members:
        RhinoDoc RhinoDocument
        GH_Document GrasshopperDocument
        IGH_Component Component
        int Iteration
    */
    #endregion

    private void RunScript(
		Line dimensionLine,
		Point3d dimensionStart,
		Point3d dimensionEnd,
		string layerName,
		bool bake,
		string dimensionStyleName,
		string userOverrideText,
		ref object A)
    {
        try
        {
            // Проверки
            if (dimensionStart.DistanceTo(dimensionEnd) < 1e-9)
            {
                A = "Ошибка: Начальная и конечная точки совпадают или слишком близки!";
                return;
            }
            if (!dimensionLine.IsValid || dimensionLine.Direction.IsTiny(1e-9))
            {
                A = "Ошибка: Линия-направление размера некорректна или вырождена!";
                return;
            }
            if (string.IsNullOrEmpty(dimensionStyleName))
            {
                A = "Ошибка: Не задано имя стиля размера!";
                return;
            }
            if (!bake)
            {
                A = "Запекание отключено. Размер не создан.";
                return;
            }

            // Документ AutoCAD
            Document doc = Application.DocumentManager.MdiActiveDocument;
            if (doc == null)
            {
                A = "Ошибка: Не удалось получить активный документ AutoCAD!";
                return;
            }
            AcadDb.Database db = doc.Database;
            Editor ed = doc.Editor;
            ed.WriteMessage("\nСоединение с AutoCAD установлено!");

            // Точки в AutoCAD
            AGeom.Point3d pStart = new AGeom.Point3d(dimensionStart.X, dimensionStart.Y, dimensionStart.Z);
            AGeom.Point3d pEnd = new AGeom.Point3d(dimensionEnd.X, dimensionEnd.Y, dimensionEnd.Z);

            // Угол поворота - из direction dimensionLine (в радианах)
            Vector3d dir = dimensionLine.Direction;
            dir.Unitize();
            double angle = Math.Atan2(dir.Y, dir.X);  // правильный угол в радианах от оси X

            // Точка на dimensionLine - проекция середины отрезка start-end на dimensionLine
            Point3d midRhino = new Point3d(0.5 * (dimensionStart.X + dimensionEnd.X),
                                          0.5 * (dimensionStart.Y + dimensionEnd.Y),
                                          0.5 * (dimensionStart.Z + dimensionEnd.Z));

            // Ближайшая точка на dimensionLine к midRhino
            Point3d closest = dimensionLine.ClosestPoint(midRhino, true);

            AGeom.Point3d dimLineLocation = new AGeom.Point3d(closest.X, closest.Y, closest.Z);

            // Транзакция
            using (DocumentLock docLock = doc.LockDocument())
            {
                using (AcadDb.Transaction tr = db.TransactionManager.StartTransaction())
                {
                    // Модельное пространство
                    AcadDb.BlockTable bt = (AcadDb.BlockTable)tr.GetObject(db.BlockTableId, AcadDb.OpenMode.ForRead);
                    AcadDb.BlockTableRecord ms = (AcadDb.BlockTableRecord)tr.GetObject(bt[AcadDb.BlockTableRecord.ModelSpace], AcadDb.OpenMode.ForWrite);

                    // Слой
                    AcadDb.LayerTable lt = (AcadDb.LayerTable)tr.GetObject(db.LayerTableId, AcadDb.OpenMode.ForRead);
                    AcadDb.ObjectId layerId;
                    if (lt.Has(layerName))
                    {
                        layerId = lt[layerName];
                    }
                    else
                    {
                        lt.UpgradeOpen();
                        AcadDb.LayerTableRecord newLayer = new AcadDb.LayerTableRecord();
                        newLayer.Name = layerName;
                        layerId = lt.Add(newLayer);
                        tr.AddNewlyCreatedDBObject(newLayer, true);
                    }

                    // Стиль размера
                    AcadDb.DimStyleTable dst = (AcadDb.DimStyleTable)tr.GetObject(db.DimStyleTableId, AcadDb.OpenMode.ForRead);
                    AcadDb.ObjectId dimStyleId = AcadDb.ObjectId.Null;
                    if (dst.Has(dimensionStyleName))
                    {
                        dimStyleId = dst[dimensionStyleName];
                    }
                    else
                    {
                        A = "Предупреждение: Стиль размера '" + dimensionStyleName + "' не найден. Используется стандартный.";
                        dimStyleId = db.Dimstyle;
                    }

                    // Создаем RotatedDimension с произвольным углом
                    AcadDb.RotatedDimension rdim = new AcadDb.RotatedDimension(
                        angle,
                        pStart,
                        pEnd,
                        dimLineLocation,
                        "",
                        dimStyleId
                    );
                    rdim.SetDatabaseDefaults();
                    rdim.LayerId = layerId;

                    // Переопределение текста
                    if (!string.IsNullOrWhiteSpace(userOverrideText))
                    {
                        rdim.DimensionText = userOverrideText;
                    }

                    // Добавляем
                    ms.AppendEntity(rdim);
                    tr.AddNewlyCreatedDBObject(rdim, true);

                    tr.Commit();

                    A = "Линейный размер с произвольным поворотом создан.\n"
                        + "Угол по линии, Стиль: " + dimensionStyleName
                        + ", Слой: " + layerName;
                }
            }
        }
        catch (AcadEx acadEx)
        {
            A = "AutoCAD ошибка: " + acadEx.Message;
        }
        catch (SysEx sysEx)
        {
            A = "Ошибка: " + sysEx.Message;
        }
    }
}
# ---------- end линейный_размер_повернут_v_2 ----------

# ----
# Повернутый размер
button_2 = Button()
pt_3 = Point(simplify(graft(Point(3907.567079, 783.4042817, 0))))
pt_4 = Point(simplify(graft(Point(5643.904015, 1323.755628, 0))))
txt_3 = LayerName("M$_Тонкая")
line_2 = Line(Line((3685.267976, 1479.857644, 0), (5421.604911, 2020.20899, 0)))
повернутый_размер_v_2 = CSharpScript(dimensionLine=line_2, dimensionStart=pt_3, dimensionEnd=pt_4, layerName=txt_3, bake=button_2, dimensionStyleName="М1_50")  # -> out, A; inputs dimensionLine: Line, dimensionStart: Point3d, dimensionEnd: Point3d, layerName: String, bake: Boolean, dimensionStyleName: String, userOverrideText: String
# ---------- повернутый_размер_v_2: C# ----------
// Grasshopper Script Instance
#region Usings
using System;
using System.Collections.Generic;

#r "C:\\Program Files\\Autodesk\\AutoCAD 2020\\accoremgd.dll"   // это ключевой для Document, Application и DocumentLock
#r "C:\\Program Files\\Autodesk\\AutoCAD 2020\\acmgd.dll"
#r "C:\\Program Files\\Autodesk\\AutoCAD 2020\\acdbmgd.dll"
#r "C:\Program Files\Autodesk\AutoCAD 2020\accoremgd.dll"
#r "C:\\Program Files\\Autodesk\\AutoCAD 2020\\acdbmgdbrep.dll"

using Rhino;
using Rhino.Geometry;

using Grasshopper;
using Grasshopper.Kernel;
using Grasshopper.Kernel.Data;
using Grasshopper.Kernel.Types;

// ----- AutoCAD -----
using Autodesk.AutoCAD.ApplicationServices;
using Autodesk.AutoCAD.EditorInput;
using AGeom = Autodesk.AutoCAD.Geometry;
using AcadDb = Autodesk.AutoCAD.DatabaseServices;
using SysEx = System.Exception;
using AcadEx = Autodesk.AutoCAD.Runtime.Exception;
#endregion

public class Script_Instance : GH_ScriptInstance
{
    #region Notes
    /* 
      Members:
        RhinoDoc RhinoDocument
        GH_Document GrasshopperDocument
        IGH_Component Component
        int Iteration
    */
    #endregion

    private void RunScript(
		Line dimensionLine,
		Point3d dimensionStart,
		Point3d dimensionEnd,
		string layerName,
		bool bake,
		string dimensionStyleName,
		string userOverrideText,
		ref object A)
    {
        try
        {
            // 1. Проверка входных данных
            if (dimensionStart.DistanceTo(dimensionEnd) < 1e-9)
            {
                A = "Ошибка: Начальная и конечная точки совпадают или слишком близки!";
                return;
            }
            if (!dimensionLine.IsValid || dimensionLine.Direction.IsTiny(1e-9))
            {
                A = "Ошибка: Линия-направление размера некорректна или вырождена!";
                return;
            }
            if (string.IsNullOrEmpty(dimensionStyleName))
            {
                A = "Ошибка: Не задано имя стиля размера!";
                return;
            }
            if (!bake)
            {
                A = "Запекание отключено. Размер не создан.";
                return;
            }

            // 2. Получаем активный документ AutoCAD
            Document doc = Application.DocumentManager.MdiActiveDocument;
            if (doc == null)
            {
                A = "Ошибка: Не удалось получить активный документ AutoCAD!";
                return;
            }
            AcadDb.Database db = doc.Database;
            Editor ed = doc.Editor;
            ed.WriteMessage("\nСоединение с AutoCAD установлено!");

            // 3. Преобразуем Rhino-точки -> AutoCAD-точки
            AGeom.Point3d pStart = new AGeom.Point3d(dimensionStart.X, dimensionStart.Y, dimensionStart.Z);
            AGeom.Point3d pEnd = new AGeom.Point3d(dimensionEnd.X, dimensionEnd.Y, dimensionEnd.Z);

            // 4. Блокируем документ + транзакция
            using (DocumentLock docLock = doc.LockDocument())
            {
                using (AcadDb.Transaction tr = db.TransactionManager.StartTransaction())
                {
                    // 4.1. Открываем таблицу блоков и модельное пространство
                    AcadDb.BlockTable bt = (AcadDb.BlockTable)tr.GetObject(db.BlockTableId, AcadDb.OpenMode.ForRead);
                    AcadDb.BlockTableRecord ms = (AcadDb.BlockTableRecord)tr.GetObject(bt[AcadDb.BlockTableRecord.ModelSpace], AcadDb.OpenMode.ForWrite);

                    // 4.2. Проверяем / создаём слой
                    AcadDb.LayerTable lt = (AcadDb.LayerTable)tr.GetObject(db.LayerTableId, AcadDb.OpenMode.ForRead);
                    AcadDb.ObjectId layerId;
                    if (lt.Has(layerName))
                    {
                        layerId = lt[layerName];
                    }
                    else
                    {
                        lt.UpgradeOpen();
                        AcadDb.LayerTableRecord newLayer = new AcadDb.LayerTableRecord();
                        newLayer.Name = layerName;
                        layerId = lt.Add(newLayer);
                        tr.AddNewlyCreatedDBObject(newLayer, true);
                    }

                    // 5. Стиль размера
                    AcadDb.DimStyleTable dst = (AcadDb.DimStyleTable)tr.GetObject(db.DimStyleTableId, AcadDb.OpenMode.ForRead);
                    AcadDb.ObjectId dimStyleId = AcadDb.ObjectId.Null;
                    if (dst.Has(dimensionStyleName))
                    {
                        dimStyleId = dst[dimensionStyleName];
                    }
                    else
                    {
                        A = "Предупреждение: Стиль размера '" + dimensionStyleName + "' не найден. "
                            + "Будет использован стиль по умолчанию.\n";
                        dimStyleId = db.Dimstyle;
                    }

                    // 6. Середина
                    AGeom.Point3d mid = new AGeom.Point3d(
                        0.5 * (pStart.X + pEnd.X),
                        0.5 * (pStart.Y + pEnd.Y),
                        0.5 * (pStart.Z + pEnd.Z)
                    );

                    // 7. Преобразуем Rhino.Line -> AGeom.Line3d
                    AGeom.Point3d lFrom = new AGeom.Point3d(dimensionLine.From.X, dimensionLine.From.Y, dimensionLine.From.Z);
                    AGeom.Point3d lTo = new AGeom.Point3d(dimensionLine.To.X, dimensionLine.To.Y, dimensionLine.To.Z);
                    AGeom.Line3d dimGuide = new AGeom.Line3d(lFrom, lTo);

                    // Ближайшая точка
                    AGeom.PointOnCurve3d poc = dimGuide.GetClosestPointTo(mid, new AGeom.Tolerance(1e-6, 1e-6));
                    AGeom.Point3d dimLinePoint = poc.Point;

                    // 8. Создаём AlignedDimension
                    AcadDb.AlignedDimension adim = new AcadDb.AlignedDimension(
                        pStart,
                        pEnd,
                        dimLinePoint,
                        "",
                        dimStyleId
                    );
                    adim.SetDatabaseDefaults();
                    adim.LayerId = layerId;

                    // 9. Пользовательский текст
                    if (!string.IsNullOrWhiteSpace(userOverrideText))
                    {
                        adim.DimensionText = userOverrideText;
                    }
                    else
                    {
                        adim.DimensionText = "";
                    }

                    // 10. Добавляем в модель
                    ms.AppendEntity(adim);
                    tr.AddNewlyCreatedDBObject(adim, true);

                    tr.Commit();

                    A = "Размер Aligned создан.\n"
                        + "Стиль: " + dimensionStyleName
                        + ", Слой: " + layerName
                        + ((string.IsNullOrWhiteSpace(userOverrideText))
                            ? ", Значение = вычисляемое"
                            : (", Текст: " + userOverrideText));
                }
            }
        }
        catch (AcadEx acadEx)
        {
            A = "AutoCAD ошибка: " + acadEx.Message;
        }
        catch (SysEx sysEx)
        {
            A = "Ошибка: " + sysEx.Message;
        }
    }
}
# ---------- end повернутый_размер_v_2 ----------

# ----
# Линейный размер
# горизонтальный/вертикальный
button_3 = Button()
pt_5 = Point(simplify(graft(Point(3907.567079, 783.4042817, 0))))
pt_6 = Point(simplify(graft(Point(5643.904015, 1323.755628, 0))))
txt_4 = LayerName("M$_Тонкая")
line_3 = Line(Line((3685.267976, 1479.857644, 0), (5421.604911, 2020.20899, 0)))
линейный_размер_v_2 = CSharpScript(dimensionLine=line_3, dimensionStart=pt_5, dimensionEnd=pt_6, layerName=txt_4, bake=button_3, dimensionStyleName="М1_50")  # -> out, A; inputs dimensionLine: Line, dimensionStart: Point3d, dimensionEnd: Point3d, layerName: String, bake: Boolean, dimensionStyleName: String, userOverrideText: String
# ---------- линейный_размер_v_2: C# ----------
// Grasshopper Script Instance
#region Usings
using System;
using System.Collections.Generic;

#r "C:\\Program Files\\Autodesk\\AutoCAD 2020\\accoremgd.dll"   // это ключевой для Document, Application и DocumentLock
#r "C:\\Program Files\\Autodesk\\AutoCAD 2020\\acmgd.dll"
#r "C:\\Program Files\\Autodesk\\AutoCAD 2020\\acdbmgd.dll"
#r "C:\Program Files\Autodesk\AutoCAD 2020\accoremgd.dll"
#r "C:\\Program Files\\Autodesk\\AutoCAD 2020\\acdbmgdbrep.dll"

using Rhino;
using Rhino.Geometry;

using Grasshopper;
using Grasshopper.Kernel;
using Grasshopper.Kernel.Data;
using Grasshopper.Kernel.Types;

// ----- AutoCAD -----
using Autodesk.AutoCAD.ApplicationServices;
using Autodesk.AutoCAD.EditorInput;
using AGeom = Autodesk.AutoCAD.Geometry;
using AcadDb = Autodesk.AutoCAD.DatabaseServices;
using SysEx = System.Exception;
using AcadEx = Autodesk.AutoCAD.Runtime.Exception;
#endregion

public class Script_Instance : GH_ScriptInstance
{
    #region Notes
    /* 
      Members:
        RhinoDoc RhinoDocument
        GH_Document GrasshopperDocument
        IGH_Component Component
        int Iteration
    */
    #endregion

    private void RunScript(
		Line dimensionLine,
		Point3d dimensionStart,
		Point3d dimensionEnd,
		string layerName,
		bool bake,
		string dimensionStyleName,
		string userOverrideText,
		ref object A)
    {
        // весь код логики тот же, что и раньше - не меняю, просто с твоей #r
        try
        {
            if (dimensionStart.DistanceTo(dimensionEnd) < 1e-9)
            {
                A = "Ошибка: Начальная и конечная точки совпадают или слишком близки!";
                return;
            }
            if (!dimensionLine.IsValid || dimensionLine.Direction.IsTiny(1e-9))
            {
                A = "Ошибка: Линия-направление размера некорректна или вырождена!";
                return;
            }
            if (string.IsNullOrEmpty(dimensionStyleName))
            {
                A = "Ошибка: Не задано имя стиля размера!";
                return;
            }
            if (!bake)
            {
                A = "Запекание отключено. Линейный размер не создан.";
                return;
            }

            Document doc = Application.DocumentManager.MdiActiveDocument;
            if (doc == null)
            {
                A = "Ошибка: Не удалось получить активный документ AutoCAD!";
                return;
            }
            AcadDb.Database db = doc.Database;
            Editor ed = doc.Editor;
            ed.WriteMessage("\nСоединение с AutoCAD установлено!");

            AGeom.Point3d pStart = new AGeom.Point3d(dimensionStart.X, dimensionStart.Y, dimensionStart.Z);
            AGeom.Point3d pEnd = new AGeom.Point3d(dimensionEnd.X, dimensionEnd.Y, dimensionEnd.Z);

            Vector3d dir = dimensionLine.Direction;
            double dx = dir.X;
            double dy = dir.Y;
            double angle;
            bool isHorizontal = (Math.Abs(dx) >= Math.Abs(dy));
            if (isHorizontal)
            {
                angle = 0.0;
            }
            else
            {
                angle = Math.PI / 2.0;
            }

            AGeom.Point3d dlStart = new AGeom.Point3d(dimensionLine.From.X, dimensionLine.From.Y, dimensionLine.From.Z);
            double midX = 0.5 * (pStart.X + pEnd.X);
            double midY = 0.5 * (pStart.Y + pEnd.Y);
            double midZ = 0.5 * (pStart.Z + pEnd.Z);
            AGeom.Point3d dimLineLocation;

            if (isHorizontal)
            {
                dimLineLocation = new AGeom.Point3d(midX, dlStart.Y, midZ);
            }
            else
            {
                dimLineLocation = new AGeom.Point3d(dlStart.X, midY, midZ);
            }

            using (DocumentLock docLock = doc.LockDocument())
            {
                using (AcadDb.Transaction tr = db.TransactionManager.StartTransaction())
                {
                    AcadDb.BlockTable bt = (AcadDb.BlockTable)tr.GetObject(db.BlockTableId, AcadDb.OpenMode.ForRead);
                    AcadDb.BlockTableRecord ms = (AcadDb.BlockTableRecord)tr.GetObject(bt[AcadDb.BlockTableRecord.ModelSpace], AcadDb.OpenMode.ForWrite);

                    AcadDb.LayerTable lt = (AcadDb.LayerTable)tr.GetObject(db.LayerTableId, AcadDb.OpenMode.ForRead);
                    AcadDb.ObjectId layerId;
                    if (lt.Has(layerName))
                    {
                        layerId = lt[layerName];
                    }
                    else
                    {
                        lt.UpgradeOpen();
                        AcadDb.LayerTableRecord newLayer = new AcadDb.LayerTableRecord();
                        newLayer.Name = layerName;
                        layerId = lt.Add(newLayer);
                        tr.AddNewlyCreatedDBObject(newLayer, true);
                    }

                    AcadDb.DimStyleTable dst = (AcadDb.DimStyleTable)tr.GetObject(db.DimStyleTableId, AcadDb.OpenMode.ForRead);
                    AcadDb.ObjectId dimStyleId = AcadDb.ObjectId.Null;
                    if (dst.Has(dimensionStyleName))
                    {
                        dimStyleId = dst[dimensionStyleName];
                    }
                    else
                    {
                        A = "Предупреждение: Стиль размера '" + dimensionStyleName + "' не найден. "
                            + "Будет использован стиль по умолчанию.\n";
                        dimStyleId = db.Dimstyle;
                    }

                    AcadDb.RotatedDimension rdim = new AcadDb.RotatedDimension(
                        angle,
                        pStart,
                        pEnd,
                        dimLineLocation,
                        "",
                        dimStyleId
                    );
                    rdim.SetDatabaseDefaults();
                    rdim.LayerId = layerId;

                    if (!string.IsNullOrWhiteSpace(userOverrideText))
                    {
                        rdim.DimensionText = userOverrideText;
                    }
                    else
                    {
                        rdim.DimensionText = "";
                    }

                    ms.AppendEntity(rdim);
                    tr.AddNewlyCreatedDBObject(rdim, true);

                    tr.Commit();

                    A = "Линейный размер ("
                        + (isHorizontal ? "горизонтальный" : "вертикальный") + ") создан.\n"
                        + "Стиль: " + dimensionStyleName
                        + ", Слой: " + layerName
                        + ((string.IsNullOrWhiteSpace(userOverrideText))
                            ? ", Значение = вычисляемое"
                            : (", Текст: " + userOverrideText));
                }
            }
        }
        catch (AcadEx acadEx)
        {
            A = "AutoCAD ошибка: " + acadEx.Message;
        }
        catch (SysEx sysEx)
        {
            A = "Ошибка: " + sysEx.Message;
        }
    }
}
# ---------- end линейный_размер_v_2 ----------

# ----
# MAKE 2D!
Z = UnitZ(Factor=1)
brep = Brep([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])
brep_2 = Brep(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)
rev = Reverse(Vector=Z)
merge = Merge(Data1=brep, Data2=brep_2)
c_script = CSharpScript(geometry=merge, direction=rev, up=rev)  # -> out, visible, hidden; inputs geometry: list of Brep, direction: Vector3d, up: Vector3d
# ---------- c_script: C# ----------
using System;
using System.Collections.Generic;
using Rhino.Geometry;
using Rhino.Display;
using Grasshopper.Kernel.Data;
using Grasshopper.Kernel.Types;

if (geometry == null || geometry.Count == 0)
{
  visible = new GH_Structure<GH_Curve>();
  hidden = new GH_Structure<GH_Curve>();
  return;
}

// Bounding box всей геометрии
BoundingBox bbox = BoundingBox.Unset;
foreach (var brep in geometry)
{
  if (brep != null) bbox.Union(brep.GetBoundingBox(true));
}

if (!bbox.IsValid)
{
  visible = new GH_Structure<GH_Curve>();
  hidden = new GH_Structure<GH_Curve>();
  return;
}

Point3d modelCenter = bbox.Center;
double diag = bbox.Diagonal.Length;
double dist = diag * 2 + 100;

// Direction
if (!direction.IsValid || direction.Length == 0)
  direction = new Vector3d(0, 0, -1);
direction.Unitize();

// Up
Vector3d defaultUp = Vector3d.CrossProduct(direction, Vector3d.XAxis);
if (defaultUp.Length < 1e-6)
  defaultUp = Vector3d.CrossProduct(direction, Vector3d.YAxis);
defaultUp.Unitize();
Vector3d viewUp = (up.IsValid && up.Length > 0) ? up : defaultUp;
viewUp.Unitize();

// Parameters
var parameters = new HiddenLineDrawingParameters();

for (int i = 0; i < geometry.Count; i++)
{
  var brep = geometry[i];
  if (brep != null)
    parameters.AddGeometry(brep, i);  // tag = индекс
}

parameters.AbsoluteTolerance = Rhino.RhinoDoc.ActiveDoc.ModelAbsoluteTolerance * 0.1;
parameters.Flatten = true;
parameters.IncludeHiddenCurves = true;
parameters.IncludeTangentEdges = false;
parameters.IncludeTangentSeams = false;

// Viewport
var viewport = new RhinoViewport();
viewport.Name = "Custom";

Point3d cameraLoc = modelCenter - direction * dist;
Point3d target = modelCenter;

viewport.SetCameraLocation(cameraLoc, false);
viewport.SetCameraTarget(target, true);
viewport.CameraUp = viewUp;
viewport.ChangeToParallelProjection(true);
viewport.ZoomBoundingBox(bbox);

parameters.SetViewport(viewport);

// Compute
HiddenLineDrawing hld = HiddenLineDrawing.Compute(parameters, true);

if (hld == null)
{
  visible = new GH_Structure<GH_Curve>();
  hidden = new GH_Structure<GH_Curve>();
  return;
}

// Структуры для tree
var visibleTree = new GH_Structure<GH_Curve>();
var hiddenTree = new GH_Structure<GH_Curve>();

// Все кривые для фикса смещения
var allCurves = new List<Curve>();

foreach (var segment in hld.Segments)
{
  Curve crv = segment.CurveGeometry.DuplicateCurve();
  allCurves.Add(crv);

  // Получаем tag (индекс объекта)
  object tagObj = segment.ParentCurve.SourceObject.Tag;
  int objIndex = (tagObj is int) ? (int)tagObj : -1;

  if (objIndex < 0 || objIndex >= geometry.Count) continue;

  GH_Path path = new GH_Path(objIndex);
  GH_Curve ghCrv = new GH_Curve(crv);

  if (segment.SegmentVisibility == HiddenLineDrawingSegment.Visibility.Visible)
    visibleTree.Append(ghCrv, path);
  else if (segment.SegmentVisibility == HiddenLineDrawingSegment.Visibility.Hidden)
    hiddenTree.Append(ghCrv, path);
}

// Фикс смещения глобально
if (allCurves.Count > 0)
{
  BoundingBox hldBox = BoundingBox.Unset;
  foreach (var c in allCurves)
    hldBox.Union(c.GetBoundingBox(true));

  Point3d hldCenter = hldBox.Center;
  Vector3d moveVec = modelCenter - hldCenter;

  Transform move = Transform.Translation(moveVec);

  // Трансформируем все в tree
  foreach (var branch in visibleTree.Branches)
    foreach (var gc in branch)
      gc.Value.Transform(move);

  foreach (var branch in hiddenTree.Branches)
    foreach (var gc in branch)
      gc.Value.Transform(move);
}

visible = visibleTree;
hidden = hiddenTree;
# ---------- end c_script ----------
crv = Curve(c_script.visible)
crv_2 = Curve(c_script.hidden)

# ----
# Полилиния по точкам
crv_3 = Curve(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)
cp = ControlPoints(Curve=crv_3)  # -> Points, Weights, Knots
txt_5 = LayerName("M$_Тонкая")
полилиния_по_точкам_v_2 = CSharpScript(pts=cp.Points, layerName=txt_5, bake=Button())  # -> out, A; inputs pts: list of Point3d, layerName: String, bake: Boolean
# ---------- полилиния_по_точкам_v_2: C# ----------
// Grasshopper Script Instance
#region Usings
using System;
using System.Collections.Generic;

#r "C:\\Program Files\\Autodesk\\AutoCAD 2020\\accoremgd.dll"   // это ключевой для Document, Application и DocumentLock
#r "C:\\Program Files\\Autodesk\\AutoCAD 2020\\acmgd.dll"
#r "C:\\Program Files\\Autodesk\\AutoCAD 2020\\acdbmgd.dll"
#r "C:\Program Files\Autodesk\AutoCAD 2020\accoremgd.dll"
#r "C:\\Program Files\\Autodesk\\AutoCAD 2020\\acdbmgdbrep.dll"

using Rhino;
using Rhino.Geometry;

using Grasshopper;
using Grasshopper.Kernel;
using Grasshopper.Kernel.Data;
using Grasshopper.Kernel.Types;

// ----- AutoCAD -----
using Autodesk.AutoCAD.ApplicationServices;
using Autodesk.AutoCAD.DatabaseServices;
using Autodesk.AutoCAD.EditorInput;
using AGeom = Autodesk.AutoCAD.Geometry;
using AcadDb = Autodesk.AutoCAD.DatabaseServices;
using AcadApp = Autodesk.AutoCAD.ApplicationServices;
using AcadEd = Autodesk.AutoCAD.EditorInput;
using SysEx = System.Exception;
using AcadEx = Autodesk.AutoCAD.Runtime.Exception;
#endregion

public class Script_Instance : GH_ScriptInstance
{
    #region Notes
    /* 
      Members:
        RhinoDoc RhinoDocument
        GH_Document GrasshopperDocument
        IGH_Component Component
        int Iteration
    */
    #endregion

    private void RunScript(
		List<Point3d> pts,
		string layerName,
		bool bake,
		ref object A)
    {
        try
        {
            // Проверяем, есть ли точки
            if (pts == null || pts.Count < 2)
            {
                A = "Ошибка: Нужно минимум 2 точки для создания полилинии!";
                return;
            }

            // Получаем активный AutoCAD
            AcadApp.Document doc = AcadApp.Application.DocumentManager.MdiActiveDocument;
            if (doc == null)
            {
                A = "Ошибка: Не удалось получить активный документ AutoCAD.";
                return;
            }
            AcadDb.Database db = doc.Database;
            AcadEd.Editor ed = doc.Editor;
            ed.WriteMessage("\nСоединение с AutoCAD установлено!");

            if (!bake)
            {
                A = "Запекание отключено. Полилиния не создана.";
                return;
            }

            // Блокируем документ
            using (AcadApp.DocumentLock docLock = doc.LockDocument())
            {
                using (AcadDb.Transaction tr = db.TransactionManager.StartTransaction())
                {
                    // ModelSpace
                    AcadDb.BlockTable bt = (AcadDb.BlockTable)tr.GetObject(db.BlockTableId, AcadDb.OpenMode.ForRead);
                    AcadDb.BlockTableRecord ms = (AcadDb.BlockTableRecord)tr.GetObject(bt[AcadDb.BlockTableRecord.ModelSpace], AcadDb.OpenMode.ForWrite);

                    // Слой
                    AcadDb.LayerTable lt = (AcadDb.LayerTable)tr.GetObject(db.LayerTableId, AcadDb.OpenMode.ForRead);
                    AcadDb.ObjectId layerId;
                    if (lt.Has(layerName))
                    {
                        layerId = lt[layerName];
                    }
                    else
                    {
                        lt.UpgradeOpen();
                        AcadDb.LayerTableRecord newLayer = new AcadDb.LayerTableRecord();
                        newLayer.Name = layerName;
                        layerId = lt.Add(newLayer);
                        tr.AddNewlyCreatedDBObject(newLayer, true);
                    }

                    // Создаём точки для полилинии (только X и Y, Z игнорируем - 2D полилиния)
                    List<AGeom.Point2d> polylinePoints = new List<AGeom.Point2d>();
                    foreach (Point3d pt in pts)
                    {
                        polylinePoints.Add(new AGeom.Point2d(pt.X, pt.Y));
                    }

                    // Создаём полилинию
                    AcadDb.Polyline polyline = new AcadDb.Polyline();
                    for (int i = 0; i < polylinePoints.Count; i++)
                    {
                        polyline.AddVertexAt(i, polylinePoints[i], 0, 0, 0);
                    }
                    polyline.Closed = false; // открытая полилиния
                    polyline.LayerId = layerId;

                    // Добавляем в модель
                    ms.AppendEntity(polyline);
                    tr.AddNewlyCreatedDBObject(polyline, true);

                    tr.Commit();
                }
            }

            A = "Полилиния успешно создана в слое '" + layerName + "'!";
        }
        catch (AcadEx e)
        {
            A = "AutoCAD ошибка: " + e.Message;
        }
        catch (SysEx e)
        {
            A = "Ошибка: " + e.Message;
        }
    }
}
# ---------- end полилиния_по_точкам_v_2 ----------

# ----
# Полилиния по кривым
button_4 = Button()
crv_4 = Curve(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)
txt_6 = LayerName("M$_Тонкая")
полилиния_v_2 = CSharpScript(inputCurve=crv_4, layerName=txt_6, bake=button_4, tolerance="1")  # -> out, A; inputs layerName: String, bake: Boolean, tolerance: Double
# ---------- полилиния_v_2: C# ----------
// Grasshopper Script Instance
#region Usings
using System;
using System.Collections.Generic;

#r "C:\\Program Files\\Autodesk\\AutoCAD 2020\\accoremgd.dll"   // это ключевой для Document, Application и DocumentLock
#r "C:\\Program Files\\Autodesk\\AutoCAD 2020\\acmgd.dll"
#r "C:\\Program Files\\Autodesk\\AutoCAD 2020\\acdbmgd.dll"
#r "C:\Program Files\Autodesk\AutoCAD 2020\accoremgd.dll"
#r "C:\\Program Files\\Autodesk\\AutoCAD 2020\\acdbmgdbrep.dll"

using Rhino;
using Rhino.Geometry;

using Grasshopper;
using Grasshopper.Kernel;
using Grasshopper.Kernel.Data;
using Grasshopper.Kernel.Types;

// ----- AutoCAD -----
using Autodesk.AutoCAD.ApplicationServices;
using Autodesk.AutoCAD.DatabaseServices;
using Autodesk.AutoCAD.EditorInput;
using AGeom = Autodesk.AutoCAD.Geometry;
using AcadDb = Autodesk.AutoCAD.DatabaseServices;
using AcadApp = Autodesk.AutoCAD.ApplicationServices;
using AcadEd = Autodesk.AutoCAD.EditorInput;
using SysEx = System.Exception;
using AcadEx = Autodesk.AutoCAD.Runtime.Exception;
#endregion

public class Script_Instance : GH_ScriptInstance
{
    #region Notes
    /* 
      Members:
        RhinoDoc RhinoDocument
        GH_Document GrasshopperDocument
        IGH_Component Component
        int Iteration
    */
    #endregion

    private void RunScript(
		object inputCurve,
		string layerName,
		bool bake,
		double tolerance,
		ref object A)
    {
        Rhino.Geometry.Curve crv = inputCurve as Rhino.Geometry.Curve;

        try
        {
            if (crv == null || !crv.IsValid || crv.GetLength() < 1e-9)
            {
                A = "Ошибка: Кривая некорректна или пустая!";
                return;
            }
            if (!bake)
            {
                A = "Запекание отключено. Полилиния не создана.";
                return;
            }

            AcadApp.Document doc = AcadApp.Application.DocumentManager.MdiActiveDocument;
            if (doc == null)
            {
                A = "Ошибка: Не удалось получить активный документ AutoCAD.";
                return;
            }
            AcadDb.Database db = doc.Database;
            AcadEd.Editor ed = doc.Editor;
            ed.WriteMessage("\nСоединение с AutoCAD установлено!");

            using (AcadApp.DocumentLock docLock = doc.LockDocument())
            {
                using (AcadDb.Transaction tr = db.TransactionManager.StartTransaction())
                {
                    AcadDb.BlockTable bt = (AcadDb.BlockTable)tr.GetObject(db.BlockTableId, AcadDb.OpenMode.ForRead);
                    AcadDb.BlockTableRecord ms = (AcadDb.BlockTableRecord)tr.GetObject(bt[AcadDb.BlockTableRecord.ModelSpace], AcadDb.OpenMode.ForWrite);

                    // Слой
                    AcadDb.LayerTable lt = (AcadDb.LayerTable)tr.GetObject(db.LayerTableId, AcadDb.OpenMode.ForRead);
                    AcadDb.ObjectId layerId;
                    if (lt.Has(layerName))
                    {
                        layerId = lt[layerName];
                    }
                    else
                    {
                        lt.UpgradeOpen();
                        AcadDb.LayerTableRecord newLayer = new AcadDb.LayerTableRecord();
                        newLayer.Name = layerName;
                        layerId = lt.Add(newLayer);
                        tr.AddNewlyCreatedDBObject(newLayer, true);
                    }

                    AcadDb.Polyline polyline = new AcadDb.Polyline();
                    polyline.LayerId = layerId;

                    List<Point3d> points = new List<Point3d>();
                    List<double> bulges = new List<double>();

                    void ProcessCurve(Rhino.Geometry.Curve curve)
                    {
                        if (curve is PolyCurve pc)
                        {
                            pc.RemoveNesting();
                            foreach (Rhino.Geometry.Curve seg in pc.Explode())
                            {
                                ProcessCurve(seg);
                            }
                        }
                        else if (curve.IsArc())
                        {
                            Rhino.Geometry.Arc arc;
                            curve.TryGetArc(out arc);
                            Point3d start = arc.StartPoint;
                            Point3d end = arc.EndPoint;

                            if (points.Count > 0 && points[points.Count - 1].DistanceTo(start) > 1e-6)
                            {
                                points.Add(start);
                                bulges.Add(0);
                            }

                            points.Add(end);
                            double theta = arc.Angle;
                            double bulge = Math.Tan(theta / 4.0);
                            if (arc.Plane.Normal.Z < 0) bulge = -bulge;
                            bulges.Add(bulge);
                        }
                        else
                        {
                            PolylineCurve pl = curve.ToPolyline(tolerance, Math.PI / 12, 0, 0);
                            for (int i = 0; i < pl.PointCount; i++)
                            {
                                Point3d pt = pl.Point(i);
                                if (i == 0 && points.Count > 0 && points[points.Count - 1].DistanceTo(pt) < 1e-6) continue;
                                points.Add(pt);
                                if (i > 0) bulges.Add(0);
                            }
                        }
                    }

                    ProcessCurve(crv);

                    for (int i = 0; i < points.Count; i++)
                    {
                        double bulge = (i < bulges.Count) ? bulges[i] : 0;
                        polyline.AddVertexAt(i, new AGeom.Point2d(points[i].X, points[i].Y), bulge, 0, 0);
                    }

                    polyline.Closed = false;

                    ms.AppendEntity(polyline);
                    tr.AddNewlyCreatedDBObject(polyline, true);

                    tr.Commit();
                }
            }

            A = "Полилиния с дугами создана в слое '" + layerName + "'!";
        }
        catch (AcadEx e)
        {
            A = "AutoCAD ошибка: " + e.Message;
        }
        catch (SysEx e)
        {
            A = "Ошибка: " + e.Message;
        }
    }
}
# ---------- end полилиния_v_2 ----------

# ----
# Мультивыноска
button_5 = Button()
list = ValueList({"_Dot", "_DotSmall"}, selected="_Dot")
pt_7 = Point(simplify(graft(Point(3907.567079, 783.4042817, 0))))
pt_8 = Point(simplify(graft(Point(5547.212058, 1634.460536, 0))))
pt_9 = Point(simplify(graft(Point(4591.285462, 295.077781, 0))))
txt_7 = LayerName("M$_Тонкая")
мультивыноска_v_2 = CSharpScript(
    leaderText="345345",
    leaderStart=pt_7,
    leaderEnd=pt_8,
    additionalPoint=pt_9,
    layerName=txt_7,
    bake=button_5,
    annotationStyleName="ОТИ",
    scaleFactor="50",
    arrowType=list)  # -> out, A; inputs leaderText: String, leaderStart: Point3d, leaderEnd: Point3d, additionalPoint: Point3d, layerName: String, bake: Boolean, annotationStyleName: String, backgroundMask: Boolean, scaleFactor: Double, arrowType: String
# ---------- мультивыноска_v_2: C# ----------
// Grasshopper Script Instance
#region Usings
using System;
using System.Collections.Generic;

#r "C:\\Program Files\\Autodesk\\AutoCAD 2020\\accoremgd.dll"   // это ключевой для Document, Application и DocumentLock
#r "C:\\Program Files\\Autodesk\\AutoCAD 2020\\acmgd.dll"
#r "C:\\Program Files\\Autodesk\\AutoCAD 2020\\acdbmgd.dll"
#r "C:\Program Files\Autodesk\AutoCAD 2020\accoremgd.dll"
#r "C:\\Program Files\\Autodesk\\AutoCAD 2020\\acdbmgdbrep.dll"

using Rhino;
using Rhino.Geometry;

using Grasshopper;
using Grasshopper.Kernel;
using Grasshopper.Kernel.Data;
using Grasshopper.Kernel.Types;

// ----- AutoCAD -----
using Autodesk.AutoCAD.ApplicationServices;
using Autodesk.AutoCAD.DatabaseServices;
using Autodesk.AutoCAD.EditorInput;
using AGeom = Autodesk.AutoCAD.Geometry;
using AcadDb = Autodesk.AutoCAD.DatabaseServices;
using AcadApp = Autodesk.AutoCAD.ApplicationServices;
using AcadEd = Autodesk.AutoCAD.EditorInput;
using SysEx = System.Exception;
using AcadEx = Autodesk.AutoCAD.Runtime.Exception;
#endregion

public class Script_Instance : GH_ScriptInstance
{
    #region Notes
    /* 
      Members:
        RhinoDoc RhinoDocument
        GH_Document GrasshopperDocument
        IGH_Component Component
        int Iteration
    */
    #endregion

    private void RunScript(
		string leaderText,
		Point3d leaderStart,
		Point3d leaderEnd,
		Point3d additionalPoint,
		string layerName,
		bool bake,
		string annotationStyleName,
		bool backgroundMask,
		double scaleFactor,
		string arrowType,
		ref object A)
    {
        try
        {
            if (string.IsNullOrEmpty(leaderText))
            {
                A = "Ошибка: Текст мультивыноски не может быть пустым!";
                return;
            }
            if (leaderStart.DistanceTo(leaderEnd) < 0.01)
            {
                A = "Ошибка: Точки слишком близко друг к другу!";
                return;
            }
            if (scaleFactor <= 0.0)
            {
                A = "Ошибка: Масштабный коэффициент должен быть > 0!";
                return;
            }

            AcadApp.Document doc = AcadApp.Application.DocumentManager.MdiActiveDocument;
            if (doc == null)
            {
                A = "Ошибка: Не удалось получить активный документ AutoCAD.";
                return;
            }
            AcadDb.Database db = doc.Database;
            AcadEd.Editor ed = doc.Editor;
            ed.WriteMessage("\nСоединение с AutoCAD установлено!");

            if (!bake)
            {
                A = "Запекание отключено. Мультивыноска не создана.";
                return;
            }

            using (AcadApp.DocumentLock docLock = doc.LockDocument())
            {
                using (AcadDb.Transaction tr = db.TransactionManager.StartTransaction())
                {
                    AcadDb.BlockTable bt = (AcadDb.BlockTable)tr.GetObject(db.BlockTableId, AcadDb.OpenMode.ForRead);
                    AcadDb.BlockTableRecord ms = (AcadDb.BlockTableRecord)tr.GetObject(bt[AcadDb.BlockTableRecord.ModelSpace], AcadDb.OpenMode.ForWrite);

                    // Слой
                    AcadDb.LayerTable lt = (AcadDb.LayerTable)tr.GetObject(db.LayerTableId, AcadDb.OpenMode.ForRead);
                    AcadDb.ObjectId layerId;
                    if (lt.Has(layerName))
                    {
                        layerId = lt[layerName];
                    }
                    else
                    {
                        lt.UpgradeOpen();
                        AcadDb.LayerTableRecord newLayer = new AcadDb.LayerTableRecord();
                        newLayer.Name = layerName;
                        layerId = lt.Add(newLayer);
                        tr.AddNewlyCreatedDBObject(newLayer, true);
                    }

                    // Масштабирование трюк
                    AGeom.Point3d S = new AGeom.Point3d(leaderStart.X, leaderStart.Y, leaderStart.Z);
                    AGeom.Point3d E = new AGeom.Point3d(leaderEnd.X, leaderEnd.Y, leaderEnd.Z);
                    AGeom.Point3d M = new AGeom.Point3d((S.X + E.X) * 0.5, (S.Y + E.Y) * 0.5, (S.Z + E.Z) * 0.5);

                    AGeom.Point3d Sprime = S;
                    AGeom.Point3d Eprime = E;
                    if (Math.Abs(scaleFactor - 1.0) > 1e-9)
                    {
                        double invK = 1.0 / scaleFactor;
                        Sprime = new AGeom.Point3d(M.X + invK * (S.X - M.X), M.Y + invK * (S.Y - M.Y), M.Z + invK * (S.Z - M.Z));
                        Eprime = new AGeom.Point3d(M.X + invK * (E.X - M.X), M.Y + invK * (E.Y - M.Y), M.Z + invK * (E.Z - M.Z));
                    }

                    AGeom.Point3d additional = new AGeom.Point3d(additionalPoint.X, additionalPoint.Y, additionalPoint.Z);
                    if (Math.Abs(scaleFactor - 1.0) > 1e-9)
                    {
                        double invK = 1.0 / scaleFactor;
                        additional = new AGeom.Point3d(M.X + invK * (additional.X - M.X), M.Y + invK * (additional.Y - M.Y), M.Z + invK * (additional.Z - M.Z));
                    }

                    // MLeader
                    AcadDb.MLeader leader = new AcadDb.MLeader();
                    leader.SetDatabaseDefaults();
                    leader.LayerId = layerId;

                    // Стиль
                    AcadDb.DBDictionary mleaderStyleDict = (AcadDb.DBDictionary)tr.GetObject(db.MLeaderStyleDictionaryId, AcadDb.OpenMode.ForRead);
                    AcadDb.ObjectId styleId = AcadDb.ObjectId.Null;
                    if (!string.IsNullOrWhiteSpace(annotationStyleName))
                    {
                        if (mleaderStyleDict.Contains(annotationStyleName))
                        {
                            styleId = mleaderStyleDict.GetAt(annotationStyleName);
                        }
                    }
                    if (!styleId.IsNull)
                    {
                        leader.MLeaderStyle = styleId;
                        AcadDb.MLeaderStyle styleObj = tr.GetObject(styleId, AcadDb.OpenMode.ForRead) as AcadDb.MLeaderStyle;
                        if (styleObj != null)
                        {
                            leader.TextStyleId = styleObj.TextStyleId;
                        }
                    }
                    else
                    {
                        ed.WriteMessage("\nПредупреждение: Стиль мультивыноски '" + annotationStyleName + "' не найден. Используется по умолчанию.\n");
                    }

                    // Тип стрелки - ищем блок по имени в BlockTable
                    if (!string.IsNullOrWhiteSpace(arrowType))
                    {
                        if (bt.Has(arrowType))
                        {
                            AcadDb.ObjectId arrowBlockId = bt[arrowType];
                            leader.ArrowSymbolId = arrowBlockId;
                        }
                        else
                        {
                            ed.WriteMessage("\nПредупреждение: Блок стрелки '" + arrowType + "' не найден в чертеже. Используется дефолт из стиля.\n");
                        }
                    }

                    // Выноски
                    int leaderIndex1 = leader.AddLeader();
                    int lineIndex1 = leader.AddLeaderLine(leaderIndex1);
                    leader.AddFirstVertex(lineIndex1, Sprime);
                    leader.AddLastVertex(lineIndex1, Eprime);

                    if (!(additionalPoint.X == 0.0 && additionalPoint.Y == 0.0 && additionalPoint.Z == 0.0))
                    {
                        int leaderIndex2 = leader.AddLeader();
                        int lineIndex2 = leader.AddLeaderLine(leaderIndex2);
                        leader.AddFirstVertex(lineIndex2, additional);
                        leader.AddLastVertex(lineIndex2, Eprime);
                    }

                    // MText
                    AcadDb.MText mtext = new AcadDb.MText();
                    mtext.Contents = leaderText;
                    mtext.TextStyleId = leader.TextStyleId;
                    mtext.TextHeight = 2.5;
                    mtext.Location = Eprime;

                    if (backgroundMask)
                    {
                        mtext.BackgroundFill = true;
                        mtext.UseBackgroundColor = true;
                        mtext.BackgroundScaleFactor = 1.1;
                    }

                    leader.MText = mtext;

                    // Обратное масштабирование
                    if (Math.Abs(scaleFactor - 1.0) > 1e-9)
                    {
                        AGeom.Matrix3d mat = AGeom.Matrix3d.Scaling(scaleFactor, M);
                        leader.TransformBy(mat);
                    }

                    ms.AppendEntity(leader);
                    tr.AddNewlyCreatedDBObject(leader, true);

                    tr.Commit();
                }
            }

            A = "Мультивыноска создана!\nСлой: " + layerName + "\nТип стрелки: " + (string.IsNullOrWhiteSpace(arrowType) ? "дефолт" : arrowType);
        }
        catch (AcadEx acadException)
        {
            A = "AutoCAD ошибка: " + acadException.Message;
        }
        catch (SysEx sysException)
        {
            A = "Ошибка: " + sysException.Message;
        }
    }
}
# ---------- end мультивыноска_v_2 ----------

# ----
# Мтекст
list_2 = ValueList({"Top Left": 1, "Top Center": 2, "Top Right": 3, "Middle Left": 4, "Middle Center": 5, "Middle Right": 6, "Bottom Left": 7, "Bottom Center": 8, "Bottom Right": 9}, selected="Middle Center")
pt_10 = Point(simplify(graft(Point(3907.567079, 783.4042817, 0))))
txt_8 = LayerName("M$_Тонкая")
bool = Boolean(True)
мтекст_v_2 = CSharpScript(
    insertPoint=pt_10,
    textContent="М1_50",
    textHeight="50",
    layerName=txt_8,
    textStyleName="Mipgost",
    rotation="0",
    alignment=list_2,
    backgroundMask=bool,
    bake=Button())  # -> out, A; inputs insertPoint: Point3d, textContent: String, textHeight: Double, layerName: String, textStyleName: String, rotation: Int32, alignment: Int32, backgroundMask: Boolean, bake: Boolean
# ---------- мтекст_v_2: C# ----------
// Grasshopper Script Instance
#region Usings
using System;
using System.Collections.Generic;
using System.Linq;

#r "C:\\Program Files\\Autodesk\\AutoCAD 2020\\accoremgd.dll"   // обязательно для Document, Application, DocumentLock
#r "C:\\Program Files\\Autodesk\\AutoCAD 2020\\acmgd.dll"
#r "C:\\Program Files\\Autodesk\\AutoCAD 2020\\acdbmgd.dll"
#r "C:\\Program Files\\Autodesk\\AutoCAD 2020\\acdbmgdbrep.dll"  // на всякий случай
#r "C:\Program Files\Autodesk\AutoCAD 2020\accoremgd.dll"


using Rhino;
using Rhino.Geometry;

using Grasshopper;
using Grasshopper.Kernel;
using Grasshopper.Kernel.Data;
using Grasshopper.Kernel.Types;

// ----- AutoCAD -----
using Autodesk.AutoCAD.ApplicationServices;
using Autodesk.AutoCAD.EditorInput;
using AGeom = Autodesk.AutoCAD.Geometry;
using AcadDb = Autodesk.AutoCAD.DatabaseServices;
using SysEx = System.Exception;
using AcadEx = Autodesk.AutoCAD.Runtime.Exception;
#endregion

public class Script_Instance : GH_ScriptInstance
{
    #region Notes
    /* 
      Members:
        RhinoDoc RhinoDocument
        GH_Document GrasshopperDocument
        IGH_Component Component
        int Iteration
    */
    #endregion

    private void RunScript(
		Point3d insertPoint,
		string textContent,
		double textHeight,
		string layerName,
		string textStyleName,
		int rotation,
		int alignment,
		bool backgroundMask,
		bool bake,
		ref object A)
    {
        try
        {
            // Проверка входных данных
            if (string.IsNullOrWhiteSpace(textContent))
            {
                A = "Ошибка: Текст не может быть пустым!";
                return;
            }
            if (textHeight <= 0)
            {
                A = "Ошибка: Высота текста должна быть больше 0!";
                return;
            }
            if (!bake)
            {
                A = "Запекание отключено. MText не создан.";
                return;
            }

            // Получаем активный документ AutoCAD
            Document doc = Application.DocumentManager.MdiActiveDocument;
            if (doc == null)
            {
                A = "Ошибка: Не удалось получить активный документ AutoCAD!";
                return;
            }

            AcadDb.Database db = doc.Database;
            Editor ed = doc.Editor;
            ed.WriteMessage("\nСоединение с AutoCAD установлено!");

            // Преобразуем Rhino-точку в AutoCAD-точку
            AGeom.Point3d acInsertPoint = new AGeom.Point3d(insertPoint.X, insertPoint.Y, insertPoint.Z);

            // Пересчитываем угол из градусов в радианы
            double rotationRadians = rotation * (Math.PI / 180);

            using (DocumentLock docLock = doc.LockDocument())
            {
                using (AcadDb.Transaction tr = db.TransactionManager.StartTransaction())
                {
                    // Открываем таблицу блоков и модельное пространство
                    AcadDb.BlockTable bt = (AcadDb.BlockTable)tr.GetObject(db.BlockTableId, AcadDb.OpenMode.ForRead);
                    AcadDb.BlockTableRecord ms = (AcadDb.BlockTableRecord)tr.GetObject(bt[AcadDb.BlockTableRecord.ModelSpace], AcadDb.OpenMode.ForWrite);

                    // Проверяем / создаём слой
                    AcadDb.LayerTable lt = (AcadDb.LayerTable)tr.GetObject(db.LayerTableId, AcadDb.OpenMode.ForRead);
                    AcadDb.ObjectId layerId;
                    if (lt.Has(layerName))
                    {
                        layerId = lt[layerName];
                    }
                    else
                    {
                        lt.UpgradeOpen();
                        AcadDb.LayerTableRecord newLayer = new AcadDb.LayerTableRecord { Name = layerName };
                        layerId = lt.Add(newLayer);
                        tr.AddNewlyCreatedDBObject(newLayer, true);
                    }

                    // Проверяем / создаём стиль текста
                    AcadDb.TextStyleTable tst = (AcadDb.TextStyleTable)tr.GetObject(db.TextStyleTableId, AcadDb.OpenMode.ForRead);
                    AcadDb.ObjectId textStyleId = AcadDb.ObjectId.Null;
                    if (tst.Has(textStyleName))
                    {
                        textStyleId = tst[textStyleName];
                    }
                    else
                    {
                        A = "Предупреждение: Стиль текста '" + textStyleName + "' не найден. Будет использован стандартный стиль.\n";
                        textStyleId = db.Textstyle;
                    }

                    // Создаём MText
                    AcadDb.MText mtext = new AcadDb.MText();
                    mtext.SetDatabaseDefaults();
                    mtext.Location = acInsertPoint;
                    mtext.TextHeight = textHeight;
                    mtext.LayerId = layerId;
                    mtext.Contents = textContent;
                    mtext.TextStyleId = textStyleId;
                    mtext.Rotation = rotationRadians;
                    mtext.Attachment = (AcadDb.AttachmentPoint)alignment;

                    if (backgroundMask)
                    {
                        mtext.BackgroundFill = true;
                        mtext.UseBackgroundColor = true;
                        mtext.BackgroundScaleFactor = 1.1;
                    }

                    // Добавляем MText в модельное пространство
                    ms.AppendEntity(mtext);
                    tr.AddNewlyCreatedDBObject(mtext, true);

                    // Завершаем транзакцию
                    tr.Commit();

                    A = "MText создан.\n" +
                        "Текст: " + textContent + "\n" +
                        "Слой: " + layerName + "\n" +
                        "Стиль: " + textStyleName + "\n" +
                        "Поворот: " + rotation + " градусов";
                }
            }
        }
        catch (AcadEx acadEx)
        {
            A = "AutoCAD ошибка: " + acadEx.Message;
        }
        catch (SysEx sysEx)
        {
            A = "Ошибка: " + sysEx.Message;
        }
    }
}
# ---------- end мтекст_v_2 ----------
